# Grasshopper definition cavepart20190902.gh (Grasshopper 1.0.7)
# plug-ins: CavernVoxel

number_slider = Slider(2, range=0..100)  # disabled
crv = Curve([<curve referenced from the Rhino model> x51])  # disabled
crv_2 = Curve([<curve referenced from the Rhino model> x51])  # disabled
crv_3 = Curve([<curve referenced from the Rhino model> x51])  # disabled
item = ListItem(List=crv, Index=expr("x+1", number_slider), Wrap=True)  # disabled
item_2 = ListItem(List=crv_3, Index=expr("x+1", number_slider), Wrap=True)  # disabled
item_3 = ListItem(List=crv, Index=number_slider, Wrap=True)  # disabled
item_4 = ListItem(List=crv_2, Index=number_slider, Wrap=True)  # disabled

crv_4 = Curve([<curve referenced from the Rhino model> x10])
start_bay = Slider(3, range=0..8)
item_5 = ListItem(List=crv_4, Index=expr("x+1", start_bay), Wrap=True)
item_6 = ListItem(List=crv_4, Index=start_bay, Wrap=True)
curvepoint = PointOnCurve(item_5, parameter=0)
curvepoint_2 = PointOnCurve(item_6, parameter=0)
curvepoint_3 = PointOnCurve(item_6, parameter=1)
pl_3pt = Plane3Pt(PointA=curvepoint_2, PointB=curvepoint_3, PointC=curvepoint)

python = GhPythonScript(x=crv_4, y=Slider(4000, range=0..10000))  # -> out, a; inputs x: list of Curve, y: Int32
# ---------- python: Python ----------
__author__ = "r.hudson"
__version__ = "2019.08.21"

import rhinoscriptsyntax as rs
import Rhino.Geometry as rg
import math
a=[]
for i in range(len(x)-1):
    n =( x[i].PointAtStart.DistanceTo(x[i+1].PointAtStart)/y*2)
    print(n)
    a.append(n)
# ---------- end python ----------
panel = Panel(python.a)
line = Line(item_3)  # disabled
line_2 = Line(item_4)  # disabled
line_3 = Line(item)  # disabled
line_4 = Line(item_2)  # disabled
lnln = LineLine(LineA=line_3, LineB=line_4)  # disabled
lnln_2 = LineLine(LineA=line, LineB=line_2)  # disabled
pflip = FlipPlane(Plane=lnln_2, ReverseX=False, ReverseY=False, SwapAxes=True)  # disabled
fly = Ladybug_fly(inputSliders=start_bay, fly=Toggle(False))  # -> Vviiiiiiiiiizzz; plug-in component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
item_7 = ListItem(List=panel, Index=start_bay, Wrap=True)
crv_5 = Curve([<curve referenced from the Rhino model> x82])
number_slider_2 = Slider(1000, range=0..1000)  # disabled
deplane = DeconstructPlane(Plane=pflip)  # -> Origin, XAxis, YAxis, ZAxis; disabled
multiplication = Multiplication(A=number_slider_2, B=deplane.ZAxis)  # disabled
mesh = Mesh(<mesh referenced from the Rhino model>)
mesh_2 = Mesh(<mesh referenced from the Rhino model>)  # disabled
deplane_2 = DeconstructPlane(Plane=lnln)  # -> Origin, XAxis, YAxis, ZAxis; disabled
sec = MeshPlane(Mesh=mesh_2, Plane=lnln_2)  # disabled
multiplication_2 = Multiplication(A=deplane_2.ZAxis, B=number_slider_2)  # disabled
bbf = BBoxFinder(MeshesToBox=mesh)  # disabled
vdis = VectorDisplay(Anchor=deplane.Origin, Vector=multiplication)  # disabled
c_script = CSharpScript(m=mesh_2, p1=lnln_2, p2=lnln)  # -> out, A; inputs m: Mesh, p1: Plane, p2: Plane; disabled
# ---------- c_script: C# ----------
    List<Mesh> keep = new List<Mesh>();
    Mesh m1 = splitHalfSpace(p1, m);
    Mesh m2 = new Mesh();
    //if m1 failed use original with p2
    if (m1 == null) m2 = splitHalfSpace(p2, m);
      //if m1 is good try and split with p2
    else m2 = splitHalfSpace(p2, m1);
    //if m2 failed just keep m1
    if (m2 == null && m1 != null) A = m1;
      //otherwise keep m2
    else
    {
      if(m2 != null) A = m2;
    }
# ---------- c_script: C# additional code ----------
  private static Mesh splitHalfSpace(Plane pln, Mesh mesh)
  {
    var splits = mesh.Split(pln);
    foreach (Mesh m in splits)
    {
      Point3d furthest = new Point3d();
      double maxDist = 0;
      foreach (Point3d p in m.Vertices)
      {
        Point3d closest = pln.ClosestPoint(p);
        if (closest.DistanceTo(p) > maxDist)
        {
          furthest = p;
          maxDist = closest.DistanceTo(p);
        }
      }

      Vector3d v = furthest - pln.Origin;
      if (Vector3d.VectorAngle(pln.Normal, v) < Math.PI / 2)
      {
        return m;
      }
    }
    return null;
  }
# ---------- end c_script ----------
c_script_2 = CSharpScript(m=mesh_2, p1=lnln_2, p2=lnln)  # -> out, A; inputs m: Mesh, p1: Plane, p2: Plane; disabled
# ---------- c_script_2: C# ----------
    List<Mesh> keep = new List<Mesh>();
    Mesh[] pieces = m.SplitDisjointPieces();
    foreach(Mesh p in pieces)
    {
      Mesh m1 = splitHalfSpace(p1, p);
      Mesh m2 = new Mesh();
      //if m1 failed use original with p2
      if (m1 == null) m2 = splitHalfSpace(p2, p);
        //if m1 is good try and split with p2
      else m2 = splitHalfSpace(p2, m1);
      //if m2 failed just keep m1
      if (m2 == null && m1 != null) keep.Add(m1);
        //otherwise keep m2
      else
      {
        if(m2 != null) keep.Add(m2);
      }
    }
    Mesh[] result = Mesh.CreateBooleanUnion(keep);
    A = keep;
# ---------- c_script_2: C# additional code ----------
  private static Mesh splitHalfSpace(Plane pln, Mesh mesh)
  {
    var splits = mesh.Split(pln);
    foreach (Mesh m in splits)
    {
      Point3d furthest = new Point3d();
      double maxDist = 0;
      foreach (Point3d p in m.Vertices)
      {
        Point3d closest = pln.ClosestPoint(p);
        if (closest.DistanceTo(p) > maxDist)
        {
          furthest = p;
          maxDist = closest.DistanceTo(p);
        }
      }

      Vector3d v = furthest - pln.Origin;
      if (Vector3d.VectorAngle(pln.Normal, v) < Math.PI / 2)
      {
        return m;
      }
    }
    return null;
  }
# ---------- end c_script_2 ----------
vdis_2 = VectorDisplay(Anchor=deplane_2.Origin, Vector=multiplication_2)  # disabled
c_script_3 = CSharpScript(m1=mesh_2, pln=lnln)  # -> out, A; inputs m1: Mesh, pln: Plane; disabled
# ---------- c_script_3: C# ----------
    var splits = m1.Split(pln);
    foreach (Mesh m in splits)
    {
      Point3d furthest = new Point3d();
      double maxDist = 0;
      foreach (Point3d p in m.Vertices)
      {
        Point3d closest = pln.ClosestPoint(p);
        if (closest.DistanceTo(p) > maxDist)
        {
          furthest = p;
          maxDist = closest.DistanceTo(p);
        }
      }

      Vector3d v = furthest - pln.Origin;
      if (Vector3d.VectorAngle(pln.Normal, v) < Math.PI / 2)
      {
        A = m;
      }
    }
    A = null;
# ---------- end c_script_3 ----------
cvox = CavernVoxel(
    Meshes=mesh,
    XCell=1000,
    YCell=Slider(2000, range=0..10000),
    ZCell=Slider(2000, range=0..10000),
    MemberThickness=Slider(100, range=0..100),
    NumberOfBaysToDisplay=Slider(2, range=0..10),
    StartBay=start_bay,
    ExploreMode=Toggle(False),
    ReferencePlane=pl_3pt,
    BuildingGrid=crv_5)  # -> TrimCells, PerimeterCells, VerticalSupportCells, CaveSlices, SectionBoxes, Grid, Links
item_8 = ListItem(List=cvox.CaveSlices, Index=Slider(4, range=0..10), Wrap=True)
cele = CavernModuleElements(Modules=cvox.VerticalSupportCells)  # -> Nodes, CentreLines, CompleteCells, CaveFaceMeshes, GSAMeshes, CellCenroids, DisjointedCaveFace, Id
cele_2 = CavernModuleElements(Modules=cvox.TrimCells)  # -> Nodes, CentreLines, CompleteCells, CaveFaceMeshes, GSAMeshes, CellCenroids, DisjointedCaveFace, Id
cele_3 = CavernModuleElements(Modules=cvox.PerimeterCells)  # -> Nodes, CentreLines, CompleteCells, CaveFaceMeshes, GSAMeshes, CellCenroids, DisjointedCaveFace, Id
tag = TextTag3D(Location=cele_3.CellCenroids, Text=cele_3.Id, Size=Slider(236, range=0..1000), Justification=7)
