# Grasshopper definition cavepart20190918.gh (Grasshopper 1.0.7)
# plug-ins: CavernVoxel

crv = Curve([<curve referenced from the Rhino model> x8])
start_bay = Slider(6, range=0..8)
item = ListItem(List=crv, Index=expr("x+1", start_bay), Wrap=True)
item_2 = ListItem(List=crv, Index=start_bay, Wrap=True)
curvepoint = PointOnCurve(item, parameter=0)
curvepoint_2 = PointOnCurve(item_2, parameter=0)
curvepoint_3 = PointOnCurve(item_2, parameter=1)
pl_3pt = Plane3Pt(PointA=curvepoint_2, PointB=curvepoint_3, PointC=curvepoint)

python = GhPythonScript(x=crv, y=Slider(6000, range=0..10000))  # -> out, a; inputs x: list of Curve, y: Int32
# ---------- python: Python ----------
__author__ = "r.hudson"
__version__ = "2019.08.21"

import rhinoscriptsyntax as rs
import Rhino.Geometry as rg
import math
a=[]
for i in range(len(x)-1):
    n =( x[i].PointAtStart.DistanceTo(x[i+1].PointAtStart)/y*2)
    print(n)
    a.append(n)
# ---------- end python ----------
panel = Panel(python.a)
fly = Ladybug_fly(inputSliders=start_bay, fly=Toggle(False))  # -> Vviiiiiiiiiizzz; plug-in component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
item_3 = ListItem(List=panel, Index=start_bay, Wrap=True)
number_slider = Slider(4, range=0..10)
mesh = Mesh(<mesh referenced from the Rhino model>)
bbf = BBoxFinder(MeshesToBox=mesh)  # disabled
brep = Brep([<brep referenced from the Rhino model> x5])
brep_2 = Brep([<brep referenced from the Rhino model> x21])
brep_3 = Brep([<brep referenced from the Rhino model> x5])
crv_2 = Curve([<curve referenced from the Rhino model> x82])
cvox = CavernVoxel(
    Meshes=mesh,
    XCell=1000,
    YCell=Slider(3000, range=0..10000),
    ZCell=Slider(2000, range=0..10000),
    MemberThickness=Slider(100, range=0..100),
    NumberOfBaysToDisplay=item_3,
    StartBay=start_bay,
    ExploreMode=Toggle(False),
    ReferencePlane=pl_3pt,
    BuildingGrid=crv_2,
    Slabs=brep_2,
    WallBoundary=brep_3,
    Roof=brep)  # -> TrimCells, PerimeterCells, VerticalSupportCells, CaveSlices, SectionBoxes, Grid, Links, UndefinedCells
item_4 = ListItem(Index=Slider(4, range=0..10), Wrap=True)  # disabled
cele = CavernModuleElements(Modules=cvox.VerticalSupportCells)  # -> Nodes, CentreLines, CompleteCells, CaveFaceMeshes, GSAMeshes, CellCenroids, DisjointedCaveFace, Id
cele_2 = CavernModuleElements(Modules=cvox.TrimCells)  # -> Nodes, CentreLines, CompleteCells, CaveFaceMeshes, GSAMeshes, CellCenroids, DisjointedCaveFace, Id
cele_3 = CavernModuleElements(Modules=cvox.PerimeterCells)  # -> Nodes, CentreLines, CompleteCells, CaveFaceMeshes, GSAMeshes, CellCenroids, DisjointedCaveFace, Id
geo = Geometry(cvox.CaveSlices)
geo_2 = Geometry(cele_2.GSAMeshes)
