# Grasshopper definition cavepart20191008.gh (Grasshopper 1.0.7)
# plug-ins: CavernVoxel

number_slider = Slider(2, range=0..10)
mesh = Mesh(<mesh referenced from the Rhino model>)
brep = Brep([<brep referenced from the Rhino model> x16])
brep_2 = Brep([<brep referenced from the Rhino model> x17])
brep_3 = Brep([<brep referenced from the Rhino model> x5])
crv = Curve([<curve referenced from the Rhino model> x82])

start_bay = Slider(1, range=0..8)
crv_2 = Curve([<curve referenced from the Rhino model> x5])
item = ListItem(List=crv_2, Index=start_bay, Wrap=True)

cp = ControlPoints(Curve=item)  # -> Points, Weights, Knots

item_2 = ListItem(List=cp.Points, Index=Slider(2, range=0..10), Wrap=True)
item_3 = ListItem(List=cp.Points, Index=Slider(0, range=0..10), Wrap=True)
item_4 = ListItem(List=cp.Points, Index=Slider(1, range=0..10), Wrap=True)
pl_3pt = Plane3Pt(PointA=item_4, PointB=item_3, PointC=item_2)

dist = Distance(PointA=item_4, PointB=item_2)
division = Division(A=dist, B=Slider(3000, range=0..10000))
cvox = CavernVoxel(
    Meshes=mesh,
    XCell=1000,
    YCell=Slider(3000, range=0..10000),
    ZCell=Slider(2000, range=0..10000),
    MemberThickness=Slider(20, range=0..100),
    NumberOfBaysToDisplay=division,
    StartBay=start_bay,
    ExploreMode=Toggle(False),
    ReferencePlane=pl_3pt,
    BuildingGrid=crv,
    Slabs=brep_2,
    WallBoundary=brep_3,
    Roof=brep)  # -> TrimCells, PerimeterCells, VerticalSupportCells, CaveSlices, SectionBoxes, Grid, Links, UndefinedCells; disabled
item_5 = ListItem(List=cvox.CaveSlices, Index=Slider(0, range=0..10), Wrap=True)
cele = CavernModuleElements(Modules=cvox.VerticalSupportCells)  # -> Nodes, CentreLines, CompleteCells, CaveFaceMeshes, GSAMeshes, CellCenroids, DisjointedCaveFace, Id
cele_2 = CavernModuleElements(Modules=cvox.TrimCells)  # -> Nodes, CentreLines, CompleteCells, CaveFaceMeshes, GSAMeshes, CellCenroids, DisjointedCaveFace, Id
cele_3 = CavernModuleElements(Modules=cvox.PerimeterCells)  # -> Nodes, CentreLines, CompleteCells, CaveFaceMeshes, GSAMeshes, CellCenroids, DisjointedCaveFace, Id
geo = Geometry(cele_2.CaveFaceMeshes)
geo_2 = Geometry(cele_2.CompleteCells)
tag = TextTag3D(Location=cele_3.CellCenroids, Text=cele_3.Id, Size=Slider(120, range=0..1000), Justification=7)
