# Grasshopper definition cavepart20191010.gh (Grasshopper 1.0.7)
# plug-ins: CaveSystem

number_slider = Slider(4, range=0..10)
mesh = Mesh(<mesh referenced from the Rhino model>)
brep = Brep([<brep referenced from the Rhino model> x12])
crv = Curve([<curve referenced from the Rhino model> x82])
brep_2 = Brep([<brep referenced from the Rhino model> x31])
brep_3 = Brep([<brep referenced from the Rhino model> x5])
number_slider_2 = Slider(31, range=0..100)
number_slider_3 = Slider(1, range=0..10)

start_bay = Slider(3, range=0..8)
crv_2 = Curve([<curve referenced from the Rhino model> x6])
item = ListItem(List=crv_2, Index=start_bay, Wrap=True)

cp = ControlPoints(Curve=item)  # -> Points, Weights, Knots

item_2 = ListItem(List=cp.Points, Index=Slider(2, range=0..10), Wrap=True)
item_3 = ListItem(List=cp.Points, Index=Slider(0, range=0..10), Wrap=True)
item_4 = ListItem(List=cp.Points, Index=Slider(1, range=0..10), Wrap=True)
pl_3pt = Plane3Pt(PointA=item_4, PointB=item_3, PointC=item_2)

dist = Distance(PointA=item_4, PointB=item_2)
division = Division(A=dist, B=Slider(3000, range=0..10000))
cs = CaveSystem(
    Meshes=mesh,
    XCell=Slider(2000, range=0..10000),
    YCell=Slider(3000, range=0..10000),
    ZCell=Slider(1000, range=0..10000),
    MemberThickness=Slider(20, range=0..100),
    NumberOfBaysToDisplay=division,
    StartBay=start_bay,
    ReferencePlane=pl_3pt,
    BuildingGrid=crv,
    Slabs=brep_2,
    WallBoundary=brep_3,
    Roof=brep)  # -> TrimCells, PerimeterCells, VerticalSupportCells, CaveSlices, SectionBoxes, Grid, Links, UndefinedCells, Boundaries
cs_2 = CaveSystemModule(Modules=cs.TrimCells)  # -> Nodes, CentreLines, CompleteCells, CaveFaceMeshes, GSAMeshes, CellCenroids, DisjointedCaveFace, Id
cs_3 = CaveSystemModule(Modules=cs.PerimeterCells)  # -> Nodes, CentreLines, CompleteCells, CaveFaceMeshes, GSAMeshes, CellCenroids, DisjointedCaveFace, Id
geo = Geometry(cs_2.CentreLines)
geo_2 = Geometry(cs_2.GSAMeshes)
