# Grasshopper definition combiner.gh (Grasshopper 1.0.7)
# plug-ins: CaveSystem

crv = Curve([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])

panel = Panel("C:\Users\r.hudson\Documents\WORK\projects\passageProjects\caveparts")
brep = Brep([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])
cs = CombineFiles(
    FolderWithFilesToReference=panel,
    SearchString="_3d",
    OutputFileName="combined.3dm",
    Run=Toggle(False),
    ReferenceGeometry=brep,
    AsReferences=Toggle(False),
    BuildingGrid=crv)
