# Grasshopper definition gh2.gh (Grasshopper 1.0.7)
# plug-ins: CavernVoxel

mesh = Mesh(<mesh referenced from the Rhino model>)
cavernvoxel = CavernVoxel(
    Meshes=mesh,
    XCell=1000,
    YCell=1000,
    ZCell=Slider(2000, range=0..10000),
    MemberThickness=60,
    NumberOfBaysToDisplay=Slider(40, range=0..100),
    StartBay=Slider(0, range=0..100))  # -> TrimCells, PerimeterCells, VerticalSupportCells, CaveSlices, SectionBoxes
cavernmoduleelements = CavernModuleElements(Modules=cavernvoxel.PerimeterCells)  # -> Nodes, CentreLines, Cells, CaveFaceMeshes, MillingVolume
cavernmoduleelements_2 = CavernModuleElements(Modules=cavernvoxel.TrimCells)  # -> Nodes, CentreLines, Cells, CaveFaceMeshes, MillingVolume
cavernmoduleelements_3 = CavernModuleElements(Modules=cavernvoxel.VerticalSupportCells)  # -> Nodes, CentreLines, Cells, CaveFaceMeshes, MillingVolume
geometry = Geometry(cavernmoduleelements_2.Nodes)
geometry_2 = Geometry(cavernmoduleelements_2.CentreLines)
geometry_3 = Geometry(cavernmoduleelements_2.Cells)
geometry_4 = Geometry(cavernmoduleelements_2.MillingVolume)
geometry_5 = Geometry(cavernmoduleelements_2.CaveFaceMeshes)
geometry_6 = Geometry(cavernmoduleelements.CentreLines)
geometry_7 = Geometry(cavernmoduleelements.Cells)
geometry_8 = Geometry(cavernmoduleelements_3.CentreLines)
geometry_9 = Geometry(cavernmoduleelements_3.Cells)
